vi "BeginRd.gvi"   [LabVIEW NXG 3.1.0]
outputs:
  "text": string
diagram:
  Get Component Directory() -> (Path=w1)
  Strip Path(path=w1) -> (stripped path=w2)
  Strip Path(path=w2) -> (stripped path=w3)
  Build Path(base path=w3, name or relative path="pyData\\data.txt") -> (appended path=w4)
  Read From Text File(file (use dialog)=w4) -> (text=w5)
  $text <- w5
