vi "DateAndTime.gvi"   [LabVIEW NXG 3.1.0]
inputs:
  "Error In": error
outputs:
  "Error Out": error
  "Time": string
  "Date": string
uses:
  Dashboard::One2Two.gvi
diagram:
  sequence {
    frame 0 {
      Get Current Time() -> (current time=w1)
      Timestamp To Date Time(time stamp=w1) -> (date time rec=w2)
      Property Node(instance in=w2) -> ("minute"=w3, "hour"=w4, "day of month"=w5, "month"=w6, "year"=w7, "day of week"=w8, "second"=w9)
      sequence {
        frame 0 {
          # Day
          Number To Decimal String(number=w5, width (-)=2) -> (decimal integer string=w10)
        }
      }
      sequence {
        frame 0 {
          Build Array("Dec", "Jan", "Feb", "Mar", "Apr", "May", "Jun", "Jul", "Aug", "Sep", "Oct", "Nov") -> w11
          Quotient And Remainder(x=w6, y=12) -> (x-y*floor(x/y)=w12)
          # Month
          Array Index(array=w11) -> (out0[w12]=w13)
        }
      }
      sequence {
        frame 0 {
          # Year
          Number To Decimal String(number=w7) -> (decimal integer string=w14)
        }
      }
      sequence {
        frame 0 {
          Concatenate Strings(w10, " ", w13, " ", w14) -> w15
          # Date
          $Date <- w15
        }
      }
      sequence {
        frame 0 {
          Build Array("Sun", "Mon", "Tue", "Wed", "Thu", "Fri", "Sat") -> w16
          Decrement(x=w8) -> w17
          Quotient And Remainder(x=w17, y=7) -> (x-y*floor(x/y)=w18)
          # Day of Week
          Array Index(array=w16) -> (out0[w18]=w19)
        }
      }
      sequence {
        frame 0 {
          Number To Decimal String(number=w4) -> (decimal integer string=w20)
          # Hour
          call "One2Two.gvi"(十进制整型字符串=w20) -> (输出=w21)
        }
      }
      sequence {
        frame 0 {
          Number To Decimal String(number=w3) -> (decimal integer string=w22)
          # Minute
          call "One2Two.gvi"(十进制整型字符串=w22) -> (输出=w23)
        }
      }
      sequence {
        frame 0 {
          Number To Decimal String(number=w9) -> (decimal integer string=w24)
          # Second
          call "One2Two.gvi"(十进制整型字符串=w24) -> (输出=w25)
        }
      }
      sequence {
        frame 0 {
          Build Array("AM", "PM") -> w26
          Quotient And Remainder(x=w4, y=12) -> (floor(x/y)=w27)
          # AM or PM
          Array Index(array=w26) -> (out0[w27]=w28)
        }
      }
      sequence {
        frame 0 {
          Concatenate Strings(w19, " ", w21, ":", w23, ":", w25, " ", w28) -> w29
          # Time
          $Time <- w29
        }
      }
    }
  }
  $"Error Out" <- $"Error In"
