vi "RunPython.gvi"   [LabVIEW NXG 3.1.0]
# yu
uses:
  NI::G Core::Libraries and Executables::System Exec.gvi
diagram:
  Get Component Directory() -> (Path=w1)
  Strip Path(path=w1) -> (stripped path=w2)
  Strip Path(path=w2) -> (stripped path=w3)
  call "System Exec.gvi"(run minimized?=TRUE, command line="python .\\pyData\\GetXML.py", working directory=w3, wait until completion?=FALSE)
  Path To String(path=w3)
