vi "Str2Arr.gvi"   [LabVIEW NXG 3.1.0]
inputs:
  "loop count": i32
  "Input": string
outputs:
  "Output": string[][]
  "Output_2": i32[]
diagram:
  s1 = $Input  # shift register
  s2 = i32[] []  # shift register
  for (N = $"loop count") (iteration -> i1) {
    s3 = s1  # shift register
    for (N = 5) {
      Search Or Split String(offset=0, search string/char=",", string=s3) -> (match + rest of string=w3, substring before match=w4)
      String Subset(offset (0)=1, string=w3) -> w5
      append w4 to w2
      next s3 = w5
    }
    Array Index(array=w2) -> (out0[3]=w6)
    Is Equal(x="Away", y=w6) -> w7
    Is Equal(x="Free", y=w6) -> w8
    Is Equal(x="Busy", y=w6) -> w9
    Logical Or(w8, w9) -> w10
    Logical Or(w10, w7) -> w11
    case (w11) {
      frame False, Default {
        w12 = s2
      }
      frame True {
        Insert Into Array(inArray=s2, new=i1) -> w12
      }
    }
    append w2 to w1
    next s1 = s3
    next s2 = w12
  }
  $Output <- w1
  $Output_2 <- s2
