vi "time1.gvi"   [LabVIEW NXG 3.1.0]
inputs:
  "字符串": string
outputs:
  "连接的字符串": string
uses:
  Dashboard::One2Two.gvi
diagram:
  Decimal String To Number(string=$"字符串") -> (number=w1)
  Quotient And Remainder(x=w1, y=60) -> (floor(x/y)=w2, x-y*floor(x/y)=w3)
  Number To Decimal String(number=w3) -> (decimal integer string=w4)
  call "One2Two.gvi"(十进制整型字符串=w4) -> (输出=w5)
  Quotient And Remainder(x=w2, y=60) -> (floor(x/y)=w6, x-y*floor(x/y)=w7)
  Number To Decimal String(number=w7) -> (decimal integer string=w8)
  call "One2Two.gvi"(十进制整型字符串=w8) -> (输出=w9)
  Number To Decimal String(number=w6) -> (decimal integer string=w10)
  call "One2Two.gvi"(十进制整型字符串=w10) -> (输出=w11)
  Concatenate Strings(w11, ":", w9, ":", w5) -> w12
  $"连接的字符串" <- w12
