vi "time3.gvi"   [LabVIEW NXG 3.1.0]
inputs:
  "字符串": string
  "布尔": bool
outputs:
  "字符串_2": string
uses:
  Dashboard::Time::time1.gvi
diagram:
  case ($"布尔") {
    frame False, Default {
      w1 = $"字符串"
    }
    frame True {
      s1 = $"字符串"  # shift register
      s2 = 0  # shift register
      for (N = 3) {
        Multiply(s2, 60) -> w2
        Search Or Split String(search string/char=":", string=s1) -> (match + rest of string=w3, substring before match=w4)
        Decimal String To Number(string=w4) -> (number=w5)
        Add(w2, w5) -> w6
        String Subset(offset (0)=1, string=w3) -> w7
        next s1 = w7
        next s2 = w6
      }
      Increment(x=s2) -> w8
      Number To Decimal String(number=w8) -> (decimal integer string=w9)
      call "time1.gvi"(字符串=w9) -> (连接的字符串=w1)
    }
  }
  $"字符串_2" <- w1
