vi "ifRestart.gvi"   [LabVIEW NXG 3.1.0]
outputs:
  "x = y?": bool
diagram:
  Get Current Time() -> (current time=w1)
  Get Date And Time String(time stamp=w1, want seconds? (F)=TRUE) -> (time string=w2)
  Is Equal(x=w2, y="8:59:45") -> w3
  $"x = y?" <- w3
