vi "keepAwake.gvi"   [LabVIEW NXG 3.1.0]
inputs:
  "x": i32
uses:
  Dashboard::Library.sli::mouse_event
diagram:
  Quotient And Remainder(x=$x, y=600) -> (x-y*floor(x/y)=w1)
  Is Equal(x=w1, y=0) -> w2
  case (w2) {
    frame False, Default { }
    frame True {
      call "mouse_event"(dwFlags in=1, dx in=-1, dy in=0, cButtons in=0, dwExtralnfo in=0)
    }
  }
  Is Equal(x=w1, y=300) -> w3
  case (w3) {
    frame False, Default { }
    frame True {
      call "mouse_event"(dwFlags in=1, dx in=1, dy in=0, cButtons in=0, dwExtralnfo in=0)
    }
  }
