vi "posCluster.gvi"   [LabVIEW NXG 3.1.0]
outputs:
  "created cluster": T1
types:
  T1 = cluster{"Element 1": cluster{"Left": f32, "Top": f32}[], "Element 2": cluster{"Left": f32, "Top": f32}[], "Element 3": cluster{"Left": f32, "Top": f32}[]}
diagram:
  sequence {
    frame 0 {
      Build Array(cluster{"Left": f32, "Top": f32} {"Left"=209, "Top"=245}, cluster{"Left": f32, "Top": f32} {"Left"=649, "Top"=245}, cluster{"Left": f32, "Top": f32} {"Left"=1089, "Top"=245}, cluster{"Left": f32, "Top": f32} {"Left"=1529, "Top"=245}, cluster{"Left": f32, "Top": f32} {"Left"=209, "Top"=677}, cluster{"Left": f32, "Top": f32} {"Left"=649, "Top"=677}, cluster{"Left": f32, "Top": f32} {"Left"=1089, "Top"=677}, cluster{"Left": f32, "Top": f32} {"Left"=1529, "Top"=677}) -> w1
    }
    frame 1 {
      Build Array(cluster{"Left": f32, "Top": f32} {"Left"=178, "Top"=207}, cluster{"Left": f32, "Top": f32} {"Left"=612, "Top"=207}, cluster{"Left": f32, "Top": f32} {"Left"=1052, "Top"=207}, cluster{"Left": f32, "Top": f32} {"Left"=1497, "Top"=207}, cluster{"Left": f32, "Top": f32} {"Left"=178, "Top"=635}, cluster{"Left": f32, "Top": f32} {"Left"=612, "Top"=6.5}, cluster{"Left": f32, "Top": f32} {"Left"=1052, "Top"=635}, cluster{"Left": f32, "Top": f32} {"Left"=1497, "Top"=635}) -> w2
    }
    frame 2 {
      Build Array(cluster{"Left": f32, "Top": f32} {"Left"=210, "Top"=246}, cluster{"Left": f32, "Top": f32} {"Left"=650, "Top"=246}, cluster{"Left": f32, "Top": f32} {"Left"=1090, "Top"=246}, cluster{"Left": f32, "Top": f32} {"Left"=1530, "Top"=246}, cluster{"Left": f32, "Top": f32} {"Left"=210, "Top"=678}, cluster{"Left": f32, "Top": f32} {"Left"=650, "Top"=678}, cluster{"Left": f32, "Top": f32} {"Left"=1090, "Top"=678}, cluster{"Left": f32, "Top": f32} {"Left"=1530, "Top"=678}, cluster{"Left": f32, "Top": f32} {"Left"=-200, "Top"=0}) -> w3
    }
  }
  Build Cluster(w1, w2, w3) -> w4
  $"created cluster" <- w4
